# Grasshopper definition maze.gh (Grasshopper 1.0.7)

python = GhPythonScript(width=Slider(10, range=0..100), depth=Slider(5, range=0..100), height=Slider(5, range=0..100))  # -> out, a; inputs width: Int32, depth: Int32, height: Int32
# ---------- python: Python ----------
from maze.maze_model import Maze
import scriptcontext as sc



m = Maze(width, depth, height)
m.build()

a = m.walls
# ---------- end python ----------
